# Grasshopper definition gh.ghx (Grasshopper 0.9.76)
# plug-ins: Python Interpreter

pipeline = GeometryPipeline(
    GroupByLayer=False,
    GroupByType=False,
    IncludeHidden=True,
    IncludeLocked=True,
    LayerFilter="boxes",
    NameFilter="*",
    TypeFilter=1073741848)
debox = DeconstructBox(Box=pipeline)  # -> Plane, X, Y, Z
dedomain = DeconstructDomain(Domain=debox.Z)  # -> Start, End
dedomain_2 = DeconstructDomain(Domain=debox.Y)  # -> graft(Start), graft(End)
dedomain_3 = DeconstructDomain(Domain=debox.X)  # -> graft(Start), graft(End)
avr = Average(Input=[dedomain_2.Start, dedomain_2.End])  # -> flatten(ArithmeticMean)
avr_2 = Average(Input=[dedomain_3.Start, dedomain_3.End])  # -> flatten(ArithmeticMean)
subtraction = Subtraction(A=dedomain.End, B=dedomain.Start)

# ---- group: merge all data
merge = Merge(Data1=graft(avr_2), Data2=graft(avr), Data3=graft(subtraction))  # -> simplify(Result)

# ---- group: convert data to string
python = PythonScript(features=merge)  # -> data; inputs features: tree
# ---------- python: Python ----------
import rhinoscriptsyntax as rs

#imports to work with GH Trees
import clr
clr.AddReference("Grasshopper")
from Grasshopper.Kernel.Data import GH_Path
from Grasshopper import DataTree

dataList = []

for i in range(features.BranchCount):
    dataList.append(list(features.Branch(i)))

import pickle
data = pickle.dumps(dataList)
# ---------- end python ----------

# ---- group: get path
python_2 = PythonScript()  # -> path
# ---------- python_2: Python ----------
import pickle

import sys
sys.path.append(path)

path = ghenv.LocalScope.ghdoc.Path
path = path.split("\\")
path = "\\".join(path[:-1]) + "\\"
# ---------- end python_2 ----------

# ----
python_3 = PythonScript(path=python_2)  # -> out, a; disabled
# ---------- python_3: Python ----------
import sys
import subprocess

def execute(command):
    process = subprocess.Popen(command, shell=True, stdout=subprocess.PIPE, stderr=subprocess.STDOUT)

    # Poll process for new output until finished
    while True:
        nextline = process.stdout.readline()
        if nextline == '' and process.poll() is not None:
            break
        sys.stdout.write(nextline)
        sys.stdout.flush()

    output = process.communicate()[0]
    exitCode = process.returncode

    if (exitCode == 0):
        return output
    else:
        raise ProcessException(command, exitCode, output)

execute(["python", path + "script.py"])
# ---------- end python_3 ----------

# ---- group: run external model
python_4 = PythonScript(path=python_2, data=python, num_clusters=Slider(3, range=0..10), run=Toggle(True))  # -> out, output
# ---------- python_4: Python ----------
if run:

    import subprocess
    
    try:
        output = subprocess.check_output(["python", path + "cluster.py", data, str(num_clusters)])
    except subprocess.CalledProcessError as e:
        print "error"
        print e.output
# ---------- end python_4 ----------

# ---- group: process model output
python_5 = PythonScript(output=python_4.output)  # -> labels, clusters
# ---------- python_5: Python ----------
import pickle

data = pickle.loads(output)

labels = data[0]
clusters = data[1]
# ---------- end python_5 ----------

# ----
python_6 = PythonScript(cluster=python_5.clusters)  # -> out, simplify(a)
# ---------- python_6: Python ----------
import rhinoscriptsyntax as rs

if len(cluster) < 3:
    extra = [0] * (3-len(cluster))
    cluster += extra

a = rs.AddPoint(cluster)
# ---------- end python_6 ----------
bnd = Bounds(Numbers=python_5.labels)
dedomain_4 = DeconstructDomain(Domain=bnd)  # -> Start, End
circle = CircleCNR(Center=python_6.a, Normal=Vector(0, 0, 1), Radius=1)
lng = ListLength(List=circle)
series = Series(Start=0, Step=1, Count=lng)
gradient = Gradient(
    LowerLimit=dedomain_4.Start,
    UpperLimit=dedomain_4.End,
    Parameter=python_5.labels,
    stops=[0: RGB(243, 57, 0), 0.221: RGB(210, 0, 118), 0.416: RGB(39, 72, 161), 0.608: RGB(1, 192, 229), 0.818: RGB(79, 186, 8), 1: RGB(220, 237, 32)])
gradient_2 = Gradient(
    LowerLimit=dedomain_4.Start,
    UpperLimit=dedomain_4.End,
    Parameter=series,
    stops=[0: RGB(243, 57, 0), 0.221: RGB(210, 0, 118), 0.416: RGB(39, 72, 161), 0.608: RGB(1, 192, 229), 0.818: RGB(79, 186, 8), 1: RGB(220, 237, 32)])
geo = Geometry(pipeline)
preview = CustomPreview(Geometry=geo, Shader=gradient)
preview_2 = CustomPreview(Geometry=circle, Shader=gradient_2)
