# Grasshopper definition model.gh (Grasshopper 1.0.7)

pipeline = GeometryPipeline(
    GroupByLayer=False,
    GroupByType=False,
    IncludeHidden=True,
    IncludeLocked=True,
    LayerFilter="boxes",
    NameFilter="*",
    SublayerFiltering=True,
    TypeFilter=1073741848)
debox = DeconstructBox(Box=pipeline)  # -> Plane, X, Y, Z
dedomain = DeconstructDomain(Domain=debox.Z)  # -> Start, End
dedomain_2 = DeconstructDomain(Domain=debox.Y)  # -> graft(Start), graft(End)
dedomain_3 = DeconstructDomain(Domain=debox.X)  # -> graft(Start), graft(End)
avr = Average(Input=[dedomain_3.Start, dedomain_3.End])  # -> flatten(ArithmeticMean)
avr_2 = Average(Input=[dedomain_2.Start, dedomain_2.End])  # -> flatten(ArithmeticMean)
subtraction = Subtraction(A=dedomain.End, B=dedomain.Start)

# ---- group: merge all data
merge = Merge(Data1=graft(avr), Data2=graft(avr_2), Data3=graft(subtraction))  # -> simplify(Result)

# ---- group: convert data to string
python = PythonScript(features=merge, num_clusters=Slider(3, range=0..10))  # -> data, json_out; inputs features: tree
# ---------- python: Python ----------
import rhinoscriptsyntax as rs

#imports to work with GH Trees
import clr
clr.AddReference("Grasshopper")
from Grasshopper.Kernel.Data import GH_Path
from Grasshopper import DataTree

features_list = []

for i in range(features.BranchCount):
    features_list.append(list(features.Branch(i)))

import pickle
data = pickle.dumps(features_list)

# SERIALIZING DATA TO TEXT
import json
json_out = json.dumps({"features": features_list, "num_clusters": num_clusters })
# ---------- end python ----------

# ----
panel = Panel(merge)

# ---- group: run external model
python_2 = GhPythonScript(input=python.json_out)  # -> out, labels, clusters
# ---------- python_2: Python ----------
import cPickle as pickle
import os
import subprocess

def quote(s):
    if s is None:
        return 'None'
    return '\"' + s + '\"'


### GET LOCAL PATH
file_path = ghenv.Component.OnPingDocument().FilePath.split("\\")


### GET PATHS TO SCRIPT AND DATA FILE
script_path = "\\".join(file_path[:-1] + ["script.py"])
temp_path = "\\".join(file_path[:-1] + ["_temp"])

print(script_path)

if not os.path.exists(temp_path):
    os.mkdir(temp_path)

data_path = temp_path + "\\script_inputs.d"


### CONFIGURE PYTHON COMMAND
cmds = []
cmds.append( "C:" )
cmds.append( "cd {}".format(quote("\\".join(file_path[:-1]))) )
cmds.append( "install.bat" )
cmds.append( "python {} {}".format(quote(script_path), quote(data_path)) )

print cmds


### DUMP DATA TO LOCAL FILE
with open(data_path, "wb") as f:
    pickle.dump(input, f)


### RUN PYTHON SCRIPT IN EXTERNAL CMD PROMPT
try:
    output = subprocess.check_output("&&".join(cmds), stderr=subprocess.STDOUT, shell=True)
except subprocess.CalledProcessError as exc:
    print 'error: code={}, out="{}"'.format(exc.returncode, exc.output, )
print output

output_path = output.split('\n')[-2]
output_path = ('\\\\').join(output_path.strip().split('\\'))
print output_path

with open(output_path, 'rb') as f:
    data_in = pickle.load(f)
print data_in

labels = data_in[0]
clusters = data_in[1]
# ---------- end python_2 ----------

# ----
panel_2 = Panel(python_2.labels)
python_3 = PythonScript(cluster=python_2.clusters)  # -> out, simplify(a)
# ---------- python_3: Python ----------
import rhinoscriptsyntax as rs

if len(cluster) < 3:
    extra = [0] * (3-len(cluster))
    cluster += extra

a = rs.AddPoint(cluster)
# ---------- end python_3 ----------
bnd = Bounds(Numbers=python_2.labels)
dedomain_4 = DeconstructDomain(Domain=bnd)  # -> Start, End
circle = CircleCNR(Center=python_3.a, Normal=Vector(0, 0, 1), Radius=1)
lng = ListLength(List=circle)
series = Series(Start=0, Step=1, Count=lng)
gradient = Gradient(
    LowerLimit=dedomain_4.Start,
    UpperLimit=dedomain_4.End,
    Parameter=python_2.labels,
    stops=[0: RGB(243, 57, 0), 0.221: RGB(210, 0, 118), 0.416: RGB(39, 72, 161), 0.608: RGB(1, 192, 229), 0.818: RGB(79, 186, 8), 1: RGB(220, 237, 32)])
gradient_2 = Gradient(
    LowerLimit=dedomain_4.Start,
    UpperLimit=dedomain_4.End,
    Parameter=series,
    stops=[0: RGB(243, 57, 0), 0.221: RGB(210, 0, 118), 0.416: RGB(39, 72, 161), 0.608: RGB(1, 192, 229), 0.818: RGB(79, 186, 8), 1: RGB(220, 237, 32)])
geo = Geometry(pipeline)
preview = CustomPreview(Geometry=geo, Shader=gradient)
preview_2 = CustomPreview(Geometry=circle, Shader=gradient_2)
